vi "Close Loop.gvi"   [LabVIEW NXG 5.0.0]
inputs:
  "error in": error
outputs:
  "error out": error
uses:
  QMH::Support::Queue FGV.gvi
diagram:
  call "Queue FGV.gvi"(error in=$"error in") -> (Queue out=w1, error out=w2)
  Release Queue(error in=w2, queue=w1) -> (error out=w3)
  $"error out" <- w3
