vi "Dequeue.gvi"   [LabVIEW NXG 5.0.0]
inputs:
  "error in": error
outputs:
  "Data": variant
  "error out": error
  "Message": string
uses:
  NI::G Core::Error::Clear Error Cluster.gvi
  QMH::Support::Queue FGV.gvi
diagram:
  case ($"error in") {
    frame Error, Default {
      To Variant(anything=$"error in") -> w3
      call "Clear Error Cluster.gvi"(error in=$"error in") -> (error out=w1)
      w2 = "Error"
    }
    frame No Error {
      call "Queue FGV.gvi"(error in=$"error in") -> (Queue out=w4, error out=w5)
      Dequeue Element(error in=w5, queue=w4) -> (element=w6, error out=w1)
      Property Node(instance in=w6) -> ("String"=w2, "Variant"=w3)
    }
  }
  $Message <- w2
  $Data <- w3
  $"error out" <- w1
