vi "Enqueue.gvi"   [LabVIEW NXG 5.0.0]
inputs:
  "Data": variant
  "Message": string
  "Priority?": bool
  "error in": error
outputs:
  "error out": error
types:
  "Message Data.gtype" = cluster{"String": string, "Variant": variant}
uses:
  QMH::Support::Queue FGV.gvi
diagram:
  case ($"error in") {
    frame Error, Default {
      w1 = $"error in"
    }
    frame No Error {
      Property Node(instance in="Message Data.gtype" {all zero or empty}, "String"=$Message, "Variant"=$Data) -> (instance out=w2)
      call "Queue FGV.gvi"(error in=$"error in") -> (Queue out=w3, error out=w4)
      case ($"Priority?") {
        frame True {
          Enqueue Element At Opposite End(element=w2, error in=w4, queue=w3) -> (error out=w1)
        }
        frame False {
          Enqueue Element(element=w2, error in=w4, queue=w3) -> (error out=w1)
        }
      }
    }
  }
  $"error out" <- w1
