vi "Pre-Loop Init.gvi"   [LabVIEW NXG 5.0.0]
inputs:
  "Queue Name": string = "QMH"
  "error in": error
outputs:
  "error out": error
  "User Events": "User Events.gtype"
types:
  "User Events.gtype" = cluster{"stop event": "event Unnamed event"}
  "Message Data.gtype" = cluster{"String": string, "Variant": variant}
uses:
  QMH::Support::Event FGV.gvi
  QMH::Support::Queue FGV.gvi
  QMH::Enqueue.gvi
diagram:
  w1 = bool TRUE  # Stop
  Create User Event(error in=$"error in", user event data type=w1) -> (error out=w2, user event out=w3)
  Property Node(instance in="User Events.gtype" {all zero or empty}, "stop event"=w3) -> (instance out=w4)
  call "Event FGV.gvi"(User Events in=w4, FGV State="Set", error in=w2) -> (User Events out=w5, error out=w6)
  $"User Events" <- w5
  Obtain Queue(element data type="Message Data.gtype" {all zero or empty}, error in=$"error in", name=$"Queue Name") -> (error out=w7, queue out=w8)
  call "Queue FGV.gvi"(queue in=w8, FGV State="Set", error in=w7) -> (error out=w9)
  call "Enqueue.gvi"(Message="Initialize", error in=w9) -> (error out=w10)
  Merge Errors(w6, w10) -> (error out=w11)
  $"error out" <- w11
