vi "Initialize.gviweb"   [LabVIEW NXG 5.0.0]
inputs:
  "Private Data in": "index data.gtype"
  "error in": error
outputs:
  "Private Data out": "index data.gtype"
  "error out": error
  "Body": string
types:
  "index data.gtype" = cluster{"Footer Text": "Text reference"}
uses:
  WebApp::Support::Website Version.gvi
diagram:
  case ($"error in") {
    frame Error, Default {
      w1 = $"error in"
      w2 = $"Private Data in"
      w3 = default
    }
    frame No Error {
      # These properties can be configured in the WebApp.gcomp
      # Document side-bar.
      Property Node(instance in=$"Private Data in") -> ("Footer Text"=w4, instance out=w2)
      call "Website Version.gvi"(error in=$"error in") -> (body=w3, Version=w5, Company=w6, Description=w7, Legal Copyright=w8, error out=w9)
      Format Into String(formatString="Website version: %s\nWebserver version: %s\n%s\n%s\n%s", errIn=w9, w5, "NaN", w6, w7, w8) -> (outString=w10, errOut=w11)
      Property Node(instance in=w4, "Text"=w10, error in=w11) -> (error out=w1)
    }
  }
  $"Private Data out" <- w2
  $Body <- w3
  $"error out" <- w1
