vi "Website Version.gvi"   [LabVIEW NXG 5.0.0]
# Get the website for its version
inputs:
  "error in": error
outputs:
  "error out": error
  "Version": string
  "Company": string
  "Description": string
  "Legal Copyright": string
  "body": string
types:
  T1 = cluster{"Product": string, "Version": string, "Company": string, "Description": string, "Legal Copyright": string}
uses:
  NI::HTTP::GET.gvi
diagram:
  call "GET.gvi"(url="version.json", error in=$"error in") -> (body=w1, error out=w2)
  # Get the website for its version.
  #
  # When LabVIEW NXG generates the code for the web application, it also generates a "version.json" file containing information regarding the Web application version
  $body <- w1
  Unflatten From Json(JSON string=w1, error in (no error)=w2, type and defaults=T1 {all zero or empty}) -> (error out=w3, value=w4)
  Property Node(instance in=w4) -> ("Version"=w5, "Company"=w6, "Description"=w7, "Legal Copyright"=w8)
  $Version <- w5
  $Company <- w6
  $Description <- w7
  $"Legal Copyright" <- w8
  $"error out" <- w3
