vi "index.gviweb"   [LabVIEW NXG 5.0.0]
panel controls:
  "Button": bool
panel indicators:
  "Message": string
types:
  "index data.gtype" = cluster{"Footer Text": "Text reference"}
uses:
  QMH::Pre-Loop Init.gvi
  QMH::Dequeue.gvi
  BusyIcon::Support::BusyState.jsli::Set Busy
  WebApp::Support::Initialize.gviweb
  BusyIcon::Support::BusyState.jsli::Unset Busy
  QMH::Close Loop.gvi
diagram:
  call "Pre-Loop Init.gvi"() -> (User Events=w1, error out=w2)
  Register For Events("Unnamed event"=w1, error in=w2) -> (error out=w3, event registration refnum out=w4)
  s1 = w3  # shift register
  s2 = "index data.gtype" {all zero or empty}  # shift register
  while {
    call "Dequeue.gvi"(error in=s1) -> (Data=w5, Message=w6, error out=w7)
    case (w6) ignore case {
      frame "Initialize" {
        call "Set Busy"(error in=w7) -> (error out=w11)
        Property Node(instance in=s2, "Footer Text"=reference to unnamed text) -> (instance out=w12)
        call "Initialize.gviweb"(error in=w11, Private Data in=w12) -> (error out=w13, Private Data out=w10)
        call "Unset Busy"(error in=w13) -> (error out=w8)
        w9 = default
      }
      frame "Error" {
        Variant To Data(error in (no error)=w7, type=w7, variant=w5) -> (data=w14, error out=w15)
        Property Node(instance in=w14) -> ("code"=w16, "source"=w17)
        Format Into String(formatString="Error %d\n%s", w16, w17) -> (outString=w18, errOut=w19)
        One Button Dialog(message=w18)
        Merge Errors(w15, w19) -> (error out=w8)
        w9 = default
        w10 = s2
      }
      frame Default {
        Format Into String(formatString="Unexpected Message \"%s\" called", errIn=w7, w6) -> (outString=w20, errOut=w8)
        One Button Dialog(message=w20)
        w9 = default
        w10 = s2
      }
      frame "Close" {
        w8 = w7
        w9 = TRUE
        w10 = s2
      }
    }
    $Message <- w6
    next s1 = w8
    next s2 = w10
    stop if w9
  }
  # Top-Level WebVIs usually contain a While Loop that never stops so that they can continue running as long as the web page is open in the user's web browser.
  while {
    event (dynamic events = w4) {
      on dynamic event 0 {
        w21 = TRUE
        w22 = w3
      }
    }
    stop if w21
  }
  Unregister For Events(error in=w22, event registration refnum=w4) -> (error out=w23)
  Merge Errors(s1, w23) -> (error out=w24)
  call "Close Loop.gvi"(error in=w24)
